# Grasshopper definition virtualAgent2_Gal.gh (Grasshopper 1.0.4)
# plug-ins: Python Interpreter

msphere = MeshSphere(
    Base=PlaneXY(0, 0, 0),
    Radius=Slider(9.312, range=0..12),
    UCount=Slider(32, range=0..100),
    VCount=Slider(34, range=0..100))
demesh = DeconstructMesh(Mesh=msphere)  # -> Vertices, Faces, Colours, Normals

zero_probability = Slider(0.5, range=0..1)
randomly_zero_some_values = PythonScript(prob=zero_probability)  # -> out, a
# ---------- randomly_zero_some_values: Python ----------
"""Provides a scripting component.
    Inputs:
        x: The x script variable
        prob: The probability for zeroing a value
    Output:
        a: The a output variable"""

__author__ = "galzemach"

import rhinoscriptsyntax as rs
import random

r = random.uniform(0, 1)
if r < prob:
	a = 0
else:
	a = x
print(r)
# ---------- end randomly_zero_some_values ----------

sphere_vertices = Data(demesh.Vertices)
pdecon = Deconstruct(Point=sphere_vertices)  # -> XComponent, YComponent, ZComponent

lng = ListLength(List=sphere_vertices)
random = Random(Range=Domain(0, 1), Number=lng, Seed=Slider(21.666, range=0..100))

get_each_points_octant = PythonScript(x=pdecon.XComponent, y=pdecon.YComponent)  # -> out, a
# ---------- get_each_points_octant: Python ----------
def quadrant():
    if (x >= 0 and y >= 0):
        return 0
    elif (x < 0 and y >= 0):
        return 1
    elif (x < 0 and y < 0):
        return 2
    elif (x >= 0 and y < 0):
        return 3


q = 2 * quadrant()
y_larger = abs(y) >= abs(x)
if ((y_larger and (q == 0 or q == 4)) or (not y_larger and (q == 2 or q == 6))):
    a = q + 1
else:
    a = q
# ---------- end get_each_points_octant ----------
factor = Slider(2.314, range=1..10)
expression = Expression(x=random, y=factor, Expression="sin(y * x)")

factor_2 = Slider(4.4, range=1..10)
factor_3 = Slider(3.4, range=1..10)
factor_4 = Slider(5.126, range=1..10)
factor_5 = Slider(6.4, range=1..10)
factor_6 = Slider(6.884, range=1..10)
factor_7 = Slider(7.663, range=1..10)
factor_8 = Slider(9.085, range=1..10)
factor_9 = Slider(1, range=1..10)
multiply_each_point_by_octant_factor = PythonScript(
    index=get_each_points_octant.a,
    value=expression,
    f0=factor_3,
    f1=factor_2,
    f2=factor_4,
    f3=factor_5,
    f4=factor_6,
    f5=factor_7,
    f6=factor_8,
    f7=factor_9)  # -> out, a
# ---------- multiply_each_point_by_octant_factor: Python ----------
a = {0 : f0, 
     1 : f1, 
     2 : f2,
     3 : f3,
     4 : f4,
     5 : f5,
     6 : f6,
     7 : f7}[index] * value
# ---------- end multiply_each_point_by_octant_factor ----------

distance_from_sphere = Number(multiply_each_point_by_octant_factor.a)
moveaway = MoveAwayFrom(Geometry=sphere_vertices, Emitter=Point(0, 0, 0), Distance=distance_from_sphere)  # -> Geometry, Transform
sphere_faces = MeshFace(demesh.Faces)

# ---- group: color by height
bounds = Bounds(Numbers=distance_from_sphere)
deconstruct_domain = DeconstructDomain(Domain=bounds)  # -> Start, End
gradient = Gradient(
    LowerLimit=deconstruct_domain.Start,
    UpperLimit=deconstruct_domain.End,
    Parameter=distance_from_sphere,
    stops=[0: RGB(0, 98, 0), 0.25: RGB(81, 175, 17), 0.5: RGB(159, 198, 146), 0.75: RGB(170, 235, 41), 1: RGB(221, 255, 53)])

# ----
conmesh = ConstructMesh(Vertices=moveaway.Geometry, Faces=sphere_faces)

# ---- group: color by normals
deconstruct_mesh = DeconstructMesh(Mesh=conmesh)  # -> Vertices, Faces, Colours, Normals
colour = Colour(deconstruct_mesh.Normals)

# ----
diffuse = ColourPicker(PickedColour=RGB(137, 132, 219))
shine = Slider(8, range=0..100)
transparency = Slider(0.218, range=0..1)
specular = ColourPicker(PickedColour=RGB(104, 115, 81))
emission = ColourPicker(PickedColour=RGB(0, 0, 0))
create_material = CreateMaterial(Diffuse=diffuse, Specular=specular, Emission=emission, Transparency=transparency, Shine=shine)

split_argb = SplitARGB(Colour=gradient)  # -> Alpha, Red, Green, Blue
graph_mapper = GraphMapper(
    split_argb.Blue,
    x0=0,
    x1=1,
    y0=0,
    y1=1,
    container_name="Sine",
    Equation_px=[0.05837437883, 1],
    Equation_py=[0.3410538435, 1])
materials = ValueList({"Original": 0, "Gradient": 1}, selected="Gradient")
colour_rgb_f = ColourRGBF(Alpha=split_argb.Alpha, Red=split_argb.Red, Green=split_argb.Green, Blue=graph_mapper)
gradient_type = ValueList({"Normals": 0, "Height": 1}, selected="Height")

z_component = Slider(10, range=0..10)
graph_mapper_2 = GraphMapper(
    z_component,
    x0=0,
    x1=10,
    y0=0,
    y1=10,
    container_name="Gaussian",
    factor=0.04082012177,
    mean=0.509961307,
    sdev=0.1590612233)
vec = VectorXYZ(XComponent=0, YComponent=0, ZComponent=graph_mapper_2)  # -> Vector, Length

color_options = StreamFilter(Gate=gradient_type, Stream0=colour, Stream1=colour_rgb_f)
mesh_colours = MeshColours(Mesh=conmesh, Colours=color_options)
material_gate = StreamFilter(Gate=materials, Stream0=conmesh, Stream1=mesh_colours)

rotate = Rotate(Geometry=material_gate, Angle=Slider(13.247, range=0..50), Plane=PlaneXY(0, 0, 0))  # -> Geometry, Transform

move = Move(Geometry=rotate.Geometry, Motion=vec.Vector)  # -> Geometry, Transform
custom_preview = CustomPreview(Geometry=move.Geometry, Shader=create_material)
